# Grasshopper definition 100hpdflat.gh (Grasshopper 1.0.8)
# plug-ins: LunchBox

# ----
# Straight Curve - Middle
straight_curve = Curve(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)

# ----
# Design Curve
crv = Curve(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)

# ----
# Straight Curve - Top
curve = Curve(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)

# ----
# Dramatic Curve
crv_2 = Curve(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)

divide = DivideCurve(Curve=crv, Count="100", Kinks=False)  # -> Points, Tangents, Parameters
merge = Merge(Data1=divide.Points)  # -> flatten(Result)

# ----
# N/S
panel = Panel("36")

# ----
# Starting Grid Parameters
panel_2 = Panel("6")

# ----
# E/W
panel_3 = Panel("34")

crv_3 = Curve(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)
boundary = BoundarySurfaces(Edges=crv_3)
quads = QuadPanels(Surface=boundary, UDivisions=panel_3, VDivisions=panel_2)
area = Area(Geometry=quads)  # -> Area, Centroid
pdecon = Deconstruct(Point=area.Centroid)  # -> XComponent, YComponent, ZComponent
cset = CreateSet(List=pdecon.YComponent)  # -> simplify(graft(Set)), Map
mindex = MemberIndex(Set=pdecon.YComponent, Member=cset.Set)  # -> simplify(Index), Count
item = ListItem(List=quads, Index=mindex.Index, Wrap=True)  # -> reverse(flatten(Item))

# ----
# Skirt
crv_4 = Curve(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)
boundary_2 = BoundarySurfaces(Edges=crv_4)
quads_2 = QuadPanels(Surface=boundary_2, UDivisions=panel_3, VDivisions=1)

crv_5 = Curve(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)
boundary_3 = BoundarySurfaces(Edges=crv_5)
quads_3 = QuadPanels(Surface=boundary_3, UDivisions=panel, VDivisions=panel_2)
area_2 = Area(Geometry=quads_3)  # -> Area, Centroid
pdecon_2 = Deconstruct(Point=area_2.Centroid)  # -> XComponent, YComponent, ZComponent
cset_2 = CreateSet(List=pdecon_2.YComponent)  # -> simplify(graft(Set)), Map
mindex_2 = MemberIndex(Set=pdecon_2.YComponent, Member=cset_2.Set)  # -> simplify(Index), Count
item_2 = ListItem(List=quads_3, Index=mindex_2.Index, Wrap=True)  # -> reverse(flatten(Item))

# ----
# Skirt
crv_6 = Curve(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)
boundary_4 = BoundarySurfaces(Edges=crv_6)
quads_4 = QuadPanels(Surface=boundary_4, UDivisions=panel, VDivisions=1)

# ----
# Screen
crv_7 = Curve(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)
boundary_5 = BoundarySurfaces(Edges=crv_7)
quads_5 = QuadPanels(Surface=boundary_5, UDivisions=panel, VDivisions=1)

crv_8 = Curve(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)
boundary_6 = BoundarySurfaces(Edges=crv_8)
quads_6 = QuadPanels(Surface=boundary_6, UDivisions=panel_3, VDivisions=panel_2)
area_3 = Area(Geometry=quads_6)  # -> Area, Centroid
pdecon_3 = Deconstruct(Point=area_3.Centroid)  # -> XComponent, YComponent, ZComponent
cset_3 = CreateSet(List=pdecon_3.YComponent)  # -> simplify(graft(Set)), Map
mindex_3 = MemberIndex(Set=pdecon_3.YComponent, Member=cset_3.Set)  # -> simplify(Index), Count
item_3 = ListItem(List=quads_6, Index=mindex_3.Index, Wrap=True)  # -> reverse(flatten(Item))

# ----
# Screen
crv_9 = Curve(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)
boundary_7 = BoundarySurfaces(Edges=crv_9)
quads_7 = QuadPanels(Surface=boundary_7, UDivisions=panel_3, VDivisions=1)

# ----
# Skirt
crv_10 = Curve(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)
boundary_8 = BoundarySurfaces(Edges=crv_10)
quads_8 = QuadPanels(Surface=boundary_8, UDivisions=panel_3, VDivisions=1)

# ----
# Screen
crv_11 = Curve(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)
boundary_9 = BoundarySurfaces(Edges=crv_11)
quads_9 = QuadPanels(Surface=boundary_9, UDivisions=panel_3, VDivisions=1)

# ----
# Screen
crv_12 = Curve(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)
boundary_10 = BoundarySurfaces(Edges=crv_12)
quads_10 = QuadPanels(Surface=boundary_10, UDivisions=panel, VDivisions=1)

# ----
# Skirt
crv_13 = Curve(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)
boundary_11 = BoundarySurfaces(Edges=crv_13)
quads_11 = QuadPanels(Surface=boundary_11, UDivisions=panel, VDivisions=1)

# ----
# Program
crv_14 = Curve(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)
boundary_12 = BoundarySurfaces(Edges=crv_14)
quads_12 = QuadPanels(Surface=boundary_12, UDivisions=panel, VDivisions=panel_2)
area_4 = Area(Geometry=quads_12)  # -> Area, Centroid
pdecon_4 = Deconstruct(Point=area_4.Centroid)  # -> XComponent, YComponent, ZComponent
cset_4 = CreateSet(List=pdecon_4.YComponent)  # -> simplify(graft(Set)), Map
mindex_4 = MemberIndex(Set=pdecon_4.YComponent, Member=cset_4.Set)  # -> simplify(Index), Count
item_4 = ListItem(List=quads_12, Index=mindex_4.Index, Wrap=True)  # -> reverse(flatten(Item))
item_5 = ListItem(List=quads_12, Index=mindex_4.Index, Wrap=True)  # -> flatten(Item)

# ----
# 4 Type Domains
panel_4 = Panel("31.25")
num = Number(["12.5", panel_4, "50"])

# ----
# 3 Type Domains
panel_5 = Panel("12.5")
num_2 = Number([panel_5, "37.5"])

# ----
# 5 Type Domains
panel_6 = Panel("37.5")
num_3 = Number(["12.5", "25", panel_6, "50"])

entwine = Entwine(Branch00=quads_11, Branch01=item_5, Branch02=quads_10, FlattenInputs=True)  # -> simplify(Result)

# ----
# SPANDREL HEIGHT
number_slider = Slider(-5, range=-12..1)

# ----
# ATTRACTOR OPTIONS
# Field Attractors
# Curves
animation_frame = Slider(9, range=0..100)
number_slider_2 = Slider(100, range=0..100)
number_slider_3 = Slider(-47, range=-100..0)
divide_2 = DivideCurve(Curve=straight_curve, Count="100", Kinks=False)  # -> Points, Tangents, Parameters
list_item = ListItem(List=divide.Points, Index=number_slider_2, Wrap=True)
list = ValueList({"Zero": 0, "One": 1, "Two": 2, "Three": 3, "Four": 4}, selected="Four")

# ----
# INPUTS
curvepoint = GetInteger(animation_frame, AtLeast=1, AtMost=100, Maximum=2147483647, Minimum=-2147483648, TreeAccess=False)

tween_curve = TweenCurve(CurveA=straight_curve, CurveB=crv, Factor=Slider(1, range=0..1), BlendType=0)
divide_3 = DivideCurve(Curve=tween_curve, Count="100", Kinks=False)  # -> Points, Tangents, Parameters

absolute = Absolute(Value=number_slider_2)
split_list = SplitList(List=divide_2.Points, Index=absolute)  # -> ListA, ListB

end_points = EndPoints(Curve=straight_curve)  # -> Start, End
list_item_2 = ListItem(List=divide_2.Points, Index=number_slider_2, Wrap=True)
line = Line(StartPoint=end_points.Start, EndPoint=list_item_2)

division = Division(A=curvepoint, B=100)
subtraction = Subtraction(A=1, B=division)

number_slider_4 = Slider(1, range=0..1)
tween_curve_2 = TweenCurve(CurveA=crv, CurveB=crv_2, Factor=subtraction, BlendType=0)
divide_4 = DivideCurve(Curve=tween_curve_2, Count="100", Kinks=False)  # -> Points, Tangents, Parameters

filter = StreamFilter(Gate=list, Stream0=list_item, Stream1=split_list.ListA, Stream2=merge, Stream3=divide_3.Points, Stream4=divide_4.Points)
filter_2 = StreamFilter(Gate=list, Stream0=list_item, Stream1=line, Stream2=crv, Stream3=tween_curve, Stream4=divide_4.Points)

# ----
# CREATE PANELS
# Project Canvas
number_slider_5 = Slider(46, range=0..100)
flip = FlipMatrix(Data=quads_12)  # -> flatten(Data)
brep_join = BrepJoin(Breps=[boundary_11, boundary_12, boundary_10, boundary_2, boundary, boundary_9, boundary_4, boundary_3, boundary_5, boundary_8, boundary_6, boundary_7])  # -> Breps, Closed
item_6 = ListItem(List=reverse(quads_10), Index=number_slider_5, Wrap=True)
brep_edges = BrepEdges(Brep=brep_join.Breps)  # -> Naked, Interior, NonManifold
item_7 = ListItem(List=reverse(quads_11), Index=number_slider_5, Wrap=True)
item_8 = ListItem(List=quads_12, Index=number_slider_5, Wrap=True)
curve_2 = Curve(brep_edges.Naked)
item_9 = ListItem(List=quads_3, Index=mindex_2.Index, Wrap=True)  # -> flatten(Item)
item_10 = ListItem(List=quads, Index=mindex.Index, Wrap=True)  # -> flatten(Item)
number_slider_6 = Slider(252, range=0..500)
join_curves = JoinCurves(Curves=curve_2, Preserve=False)
item_11 = ListItem(List=quads_6, Index=mindex_3.Index, Wrap=True)  # -> flatten(Item)
item_12 = ListItem(List=flatten(item_5), Index=number_slider_5, Wrap=True)
item_13 = ListItem(List=item_4, Index=number_slider_5, Wrap=True)  # disabled
list_2 = ValueList({"Zero": 0, "One": 1, "Two": 2, "Three": 3}, selected="Zero")
filter_3 = StreamFilter(Gate=list_2, Stream0=num_3, Stream1=num, Stream2=num_2)

entwine_2 = Entwine(Branch00=quads_4, Branch01=item_9, Branch02=quads_5, FlattenInputs=True)  # -> simplify(Result)

entwine_3 = Entwine(Branch00=quads_2, Branch01=item_10, Branch02=quads_9, FlattenInputs=True)  # -> simplify(Result)

entwine_4 = Entwine(Branch00=quads_8, Branch01=item_11, Branch02=quads_7, FlattenInputs=True)  # -> simplify(Result)

# ----
# SOUTH
cluster = Cluster(G=entwine_2, L=filter, P=filter, C=join_curves, domain=filter_3, L_2=entwine_2)  # -> R, by_level, color_panels, panel_assignments, panel_assignments_2, R_2

# ----
# NORTH
cluster_2 = Cluster(G=entwine, L=filter, P=filter, C=join_curves, domain=filter_3, L_2=entwine)  # -> R, by_level, color_panels, panel_assignments, panel_assignments_2, R_2

# ----
# WEST
cluster_3 = Cluster(G=entwine_4, L=filter, P=filter, C=join_curves, domain=filter_3, L_2=entwine_4)  # -> R, by_level, color_panels, panel_assignments, panel_assignments_2, R_2

# ----
# EAST
cluster_4 = Cluster(G=entwine_3, L=filter, P=filter, C=join_curves, domain=filter_3, L_2=entwine_3)  # -> R, by_level, color_panels, panel_assignments, panel_assignments_2, R_2

item_14 = ListItem(List=flatten(entwine_2), Index=number_slider_6, Wrap=True)
item_15 = ListItem(List=flatten(entwine_4), Index=number_slider_6, Wrap=True)

entwine_5 = Entwine(
    Branch0X=cluster_2.color_panels,
    Branch1X=cluster_4.color_panels,
    Branch2X=cluster.color_panels,
    Branch3X=cluster_3.color_panels,
    FlattenInputs=False)  # -> flatten(Result)

# ----
# OUTPUTS
context_bake = ContextBake(Content=entwine_5)

deconstruct_mesh = DeconstructMesh(Mesh=entwine_5)  # -> Vertices, Faces, Colours, Normals
list_item_3 = ListItem(List=deconstruct_mesh.Colours, Index=0, Wrap=True)  # -> flatten(Item)

# ----
# EAST
brep = Brep(boundary_6)
brep_2 = Brep(quads)
brep_3 = Brep(cluster_4.R)
cluster_5 = Cluster_2(wall=brep, A=brep_2, T=brep_3, F=number_slider)  # -> A_2, R_2, S, R
panel_7 = Panel(cluster_5.R_2)

# ----
# WEST
brep_4 = Brep(quads_6)
brep_5 = Brep(boundary_6)
brep_6 = Brep(cluster_3.R)
cluster_6 = Cluster_2(wall=brep_5, A=brep_4, T=brep_6, F=number_slider)  # -> A_2, R_2, S, R
# TOTAL
panel_8 = Panel(cluster_6.R_2)

context_print = ContextPrint(VertexColors=list_item_3)

# ----
# WINDOW WALL RATIO (Glazing Area / Solid Wall + Plenum)
brep_7 = Brep(boundary_12)
# SOUTH
brep_8 = Brep(boundary_6)
brep_9 = Brep(quads_3)
brep_10 = Brep(cluster.R)
cluster_7 = Cluster_2(wall=brep_8, A=brep_9, T=brep_10, F=number_slider)  # -> A_2, R_2, S, R
brep_11 = Brep(cluster_6.S)
brep_12 = Brep(cluster_5.S)
brep_13 = Brep(cluster_7.S)
panel_9 = Panel(cluster_7.R_2)

# ----
# NORTH
brep_14 = Brep(quads_12)
brep_15 = Brep(cluster_2.R)

cluster_8 = Cluster_2(wall=brep_7, A=brep_14, T=brep_15, F=number_slider)  # -> A_2, R_2, S, R
brep_16 = Brep(cluster_8.S)
avr = Average(Input=[cluster_8.R_2, cluster_5.R_2, cluster_7.R_2, cluster_6.R_2])
panel_10 = Panel(avr)

panel_11 = Panel(cluster_8.R_2)

# ==== cluster Cluster
P = ClusterInput()
C = ClusterInput()
incurve = PointInCurve(Point=P, Curve=C)  # -> Relationship, Point
G = ClusterInput()
equals = Equality(FirstNumber=incurve.Relationship, SecondNumber="2")  # -> Equality, Inequality
L = ClusterInput()
area = Area(Geometry=G)  # -> Area, Centroid
dispatch = Dispatch(List=L, DispatchPattern=equals.Equality)  # -> ListA, ListB
domain = ClusterInput()
cp = ClosestPoint(Point=area.Centroid, Cloud=dispatch.ListA)  # -> ClosestPoint, CPIndex, Distance
item = ListItem(List=domain, Index=0, Wrap=True)
item_2 = ListItem(List=domain, Index=1, Wrap=True)
item_3 = ListItem(List=domain, Index=2, Wrap=True)
item_4 = ListItem(List=domain, Index=3, Wrap=True)
python = GhPythonScript(x=cp.Distance, d1=item, d2=item_2, d3=item_3, d4=item_4)  # -> out, y, t1, t2, t3, t4, t5, z
# ---------- python: Python ----------
__author__ = "DMacia_smma"
__version__ = "2021.05.13"

import rhinoscriptsyntax as rs


if x < d1:
    y = "a"
    t1 = "True"
    z = 0
elif  d1 < x < d2:
    y = "b"
    t2 = "True"
    z = 1
elif  d2 < x < d3:
    y = "c"
    t3 = "True"
    z = 2
elif  d3 < x < d4:
    y = "d"
    t4 = "True"
    z = 3
else:
    y = "e"
    t5 = "True"
    z = 4
# ---------- end python ----------
L_2 = ClusterInput()
sift = SiftPattern(List=L_2, SiftPattern=python.t1)  # -> Output0, Output1
sift_2 = SiftPattern(List=L_2, SiftPattern=python.t2)  # -> Output0, Output1
sift_3 = SiftPattern(List=L_2, SiftPattern=python.t3)  # -> Output0, Output1
sift_4 = SiftPattern(List=L_2, SiftPattern=python.t4)  # -> Output0, Output1
sift_5 = SiftPattern(List=L_2, SiftPattern=python.t5)  # -> Output0, Output1
sift_6 = SiftPattern(List=python.z, SiftPattern=python.t1)  # -> Output0, Output1
sift_7 = SiftPattern(List=python.z, SiftPattern=python.t2)  # -> Output0, Output1
sift_8 = SiftPattern(List=python.z, SiftPattern=python.t3)  # -> Output0, Output1
sift_9 = SiftPattern(List=python.z, SiftPattern=python.t4)  # -> Output0, Output1
sift_10 = SiftPattern(List=python.z, SiftPattern=python.t5)  # -> Output0, Output1
scale_nu = ScaleNU(Geometry=sift_3.Output1, Plane=sift_3.Output1, ScaleX=1, ScaleY=Slider(0.3, range=0..1), ScaleZ=1)  # -> Geometry, Transform
scale_nu_2 = ScaleNU(Geometry=sift_5.Output1, Plane=sift_5.Output1, ScaleX=1, ScaleY=Slider(0.5, range=0..1), ScaleZ=1)  # -> Geometry, Transform
scale_nu_3 = ScaleNU(Geometry=sift_2.Output1, Plane=sift_2.Output1, ScaleX=1, ScaleY=Slider(0.2, range=0..1), ScaleZ=1)  # -> Geometry, Transform
scale_nu_4 = ScaleNU(Geometry=sift_4.Output1, Plane=sift_4.Output1, ScaleX=1, ScaleY=Slider(0.4, range=0..1), ScaleZ=1)  # -> Geometry, Transform
scale_nu_5 = ScaleNU(Geometry=sift.Output1, Plane=sift.Output1, ScaleX=1, ScaleY=Slider(0.1, range=0..1), ScaleZ=1)  # -> Geometry, Transform
clean = CleanTree(RemoveNulls=True, RemoveInvalid=True, RemoveEmpty=False, Tree=sift_2.Output1)
clean_2 = CleanTree(RemoveNulls=True, RemoveInvalid=True, RemoveEmpty=False, Tree=sift_3.Output1)
clean_3 = CleanTree(RemoveNulls=True, RemoveInvalid=True, RemoveEmpty=False, Tree=sift_4.Output1)
clean_4 = CleanTree(RemoveNulls=True, RemoveInvalid=True, RemoveEmpty=False, Tree=sift_5.Output1)
clean_5 = CleanTree(RemoveNulls=True, RemoveInvalid=True, RemoveEmpty=False, Tree=sift.Output1)
clean_6 = CleanTree(RemoveNulls=True, RemoveInvalid=True, RemoveEmpty=False, Tree=sift_6.Output1)
clean_7 = CleanTree(RemoveNulls=True, RemoveInvalid=True, RemoveEmpty=False, Tree=sift_7.Output1)
clean_8 = CleanTree(RemoveNulls=True, RemoveInvalid=True, RemoveEmpty=False, Tree=sift_8.Output1)
clean_9 = CleanTree(RemoveNulls=True, RemoveInvalid=True, RemoveEmpty=False, Tree=sift_9.Output1)
clean_10 = CleanTree(RemoveNulls=True, RemoveInvalid=True, RemoveEmpty=False, Tree=sift_10.Output1)
debrep = DeconstructBrep(Brep=clean)  # -> Faces, Edges, Vertices
debrep_2 = DeconstructBrep(Brep=clean_5)  # -> Faces, Edges, Vertices
debrep_3 = DeconstructBrep(Brep=clean_2)  # -> Faces, Edges, Vertices
debrep_4 = DeconstructBrep(Brep=clean_4)  # -> Faces, Edges, Vertices
debrep_5 = DeconstructBrep(Brep=clean_3)  # -> Faces, Edges, Vertices
conmesh = ConstructMesh(Vertices=debrep.Vertices, Faces={A=0, B=1, C=2, D=3}, Colours=ColourSwatch(SwatchColor=RGB(21, 255, 0)))
entwine = Entwine(
    Branch0X=scale_nu_5.Geometry,
    Branch1X=scale_nu_3.Geometry,
    Branch2X=scale_nu.Geometry,
    Branch3X=scale_nu_4.Geometry,
    Branch4X=scale_nu_2.Geometry,
    FlattenInputs=False)
conmesh_2 = ConstructMesh(Vertices=debrep_2.Vertices, Faces={A=0, B=1, C=2, D=3}, Colours=ColourSwatch(SwatchColor=RGB(0, 98, 255)))
conmesh_3 = ConstructMesh(Vertices=debrep_3.Vertices, Faces={A=0, B=1, C=2, D=3}, Colours=ColourSwatch(SwatchColor=RGB(247, 255, 0)))
conmesh_4 = ConstructMesh(Vertices=debrep_4.Vertices, Faces={A=0, B=1, C=2, D=3}, Colours=ColourSwatch(SwatchColor=RGB(255, 0, 0)))
conmesh_5 = ConstructMesh(Vertices=debrep_5.Vertices, Faces={A=0, B=1, C=2, D=3}, Colours=ColourSwatch(SwatchColor=RGB(255, 183, 0)))
merge = Merge(
    Data1=scale_nu_5.Geometry,
    Data2=scale_nu_3.Geometry,
    Data3=scale_nu.Geometry,
    Data4=scale_nu_4.Geometry,
    Data5=scale_nu_2.Geometry)
entwine_2 = Entwine(Branch00=clean_6, Branch01=clean_7, Branch02=clean_8, Branch03=clean_9, Branch04=clean_10, FlattenInputs=True)
entwine_3 = Entwine(Branch00=conmesh_2, Branch01=conmesh, Branch02=conmesh_3, Branch03=conmesh_5, Branch04=conmesh_4, FlattenInputs=True)
by_level = ClusterOutput(entwine)
R = ClusterOutput(merge)
clean_11 = CleanTree(RemoveNulls=True, RemoveInvalid=True, RemoveEmpty=False, Tree=entwine_3)
R_2 = ClusterOutput(entwine_2)
panel_assignments = ClusterOutput(python.z)
panel_assignments_2 = ClusterOutput(python.z)
color_panels = ClusterOutput(clean_11)
panel = Panel(python.y)
panel_2 = Panel(python.z)
panel_3 = Panel(entwine_3)

# ==== cluster Cluster_2
T = ClusterInput()
A = ClusterInput()
branch = TreeBranch(Tree=T, Path="{1}", MaintainPaths=True)
sdiff = SolidDifference(BrepsA=A, BrepsB=flatten(branch))
number_slider = Slider(1, range=0..4)
number_slider_2 = Slider(3, range=0..4)
debrep = DeconstructBrep(Brep=sdiff)  # -> Faces, Edges, simplify(Vertices)
F = ClusterInput()
item = ListItem(List=debrep.Vertices, Index=[number_slider, number_slider_2], Wrap=True)
Y = UnitY(Factor=F)
move = Move(Geometry=item, Motion=Y)  # -> Geometry, Transform
replace = ReplaceItems(List=debrep.Vertices, Item=move.Geometry, Indices=[number_slider, number_slider_2], Wrap=False)
srfgrid = SurfaceFromPoints(Points=replace, UCount=2, Interpolate=False)
S = ClusterOutput(srfgrid)
area = Area(Geometry=srfgrid)  # -> Area, Centroid
wall = ClusterInput()
area_2 = Area(Geometry=wall)  # -> Area, Centroid
ma = MassAddition(Input=flatten(area.Area))  # -> Result, PartialResults
A_2 = ClusterOutput(area_2.Area)
division = Division(A=ma.Result, B=area_2.Area)
R = ClusterOutput(ma.Result)
R_2 = ClusterOutput(division)
