# Grasshopper definition andoverTree.gh (Grasshopper 1.0.8)
# plug-ins: treesloth01, Pufferfish

# ----
# INPUT
slight_vertical_offset_both_ways_inch = Slider(0.125, range=0..1)
vertoffset = GetNumber(
    slight_vertical_offset_both_ways_inch,
    AtLeast=0,
    AtMost=1,
    Maximum=1.797693135e+308,
    Minimum=-1.797693135e+308,
    TreeAccess=False)
slight_horizontal_offset_both_ways_inch = Slider(0.125, range=0..1)
horizoffset = GetNumber(
    slight_horizontal_offset_both_ways_inch,
    AtLeast=0,
    AtMost=1,
    Maximum=1.797693135e+308,
    Minimum=-1.797693135e+308,
    TreeAccess=False)
plywood_thickness_inch = Slider(0.5, range=0..1)
plywoodthickness = GetNumber(plywood_thickness_inch, AtLeast=0, AtMost=1, Maximum=1.797693135e+308, Minimum=-1.797693135e+308, TreeAccess=False)

srf = Surface([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])
# GEOMETRY
debrep = DeconstructBrep(Brep=srf)  # -> Faces, Edges, Vertices
midpt = CurveMiddle(Curve=debrep.Edges)
pdecon = Deconstruct(Point=midpt)  # -> XComponent, YComponent, ZComponent
sort = SortList(Keys=pdecon.ZComponent, ValuesA=debrep.Edges)  # -> Keys, ValuesA
first_last = FirstLast(List=sort.ValuesA)  # -> FirstValue, LastValue
division = Division(A=vertoffset, B=12)
crv = Curve(first_last.LastValue)
neg = Negative(Value=division)
ext = ExtendCurve(Curve=first_last.FirstValue, Type=0, Start=neg, End=neg)
ext_2 = ExtendCurve(Curve=first_last.LastValue, Type=0, Start=neg, End=neg)
end = EndPoints(Curve=ext_2)  # -> Start, End
end_2 = EndPoints(Curve=ext)  # -> Start, End
srf4pt = _4PointSurface(CornerA=end.Start, CornerB=end.End, CornerC=end_2.Start, CornerD=end_2.End)  # -> flatten(Surface)
division_2 = Division(A=horizoffset, B=12)
srf_2 = Surface([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])
neg_2 = Negative(Value=division_2)
offset = OffsetSurface(Surface=srf_2, Distance=division_2, Retrim=True)
offset_2 = OffsetSurface(Surface=srf_2, Distance=neg_2, Retrim=True)
splitmul = SplitBrepMultiple(Brep=srf4pt, Cutters=srf_2)
splitmul_2 = SplitBrepMultiple(Brep=splitmul, Cutters=offset)
item = ListItem(List=splitmul, Index=Slider(2, range=0..22), Wrap=True)
item_2 = ListItem(List=splitmul_2, Index=0, Wrap=True)
splitmul_3 = SplitBrepMultiple(Brep=item_2, Cutters=offset_2)
item_3 = ListItem(List=splitmul_3, Index=1, Wrap=True)
division_3 = Division(A=plywoodthickness, B=12)
offsrf = OffsetSurface(Surface=item_3, Distance=division_3, BothSides=0, CreateSolid=True)
brep = Brep([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])
sdiff = SolidDifference(BrepsA=offsrf, BrepsB=brep)
item_4 = ListItem(List=sdiff, Index=0, Wrap=True)  # -> flatten(Item)
mesh_brep = MeshBrep(
    Brep=item_4,
    Settings={GridMaxCount=0, GridMinCount=16, JaggedSeams=False, MaxEdgeLength=0, MinEdgeLength=0.0001, MinTolerance=0, Refine=True, RefineAngle=0, RelativeTolerance=0.65, SimplePlanes=True, Tolerance=0})

# ----
# OUTPUT
context_bake = ContextBake(Content=mesh_brep)
